# Grasshopper definition 20240729_Plan Trees.gh (Grasshopper 1.0.8)

point = Point([Point(-32.37939963, 360.6823885, 0), Point(114.3321994, 415.4497436, 0), Point(175.8901649, 289.7234592, 0)])
graft_tree = GraftTree(Tree=point, IncludeEmptyLists=True, IncludeNullItems=True)
panel = Panel("outer circle")
panel_2 = Panel("inner circle")

# ----
# randomising size of trees and scaling the inner circles to outer circles proportionally
number_slider = Slider(26, range=0..50)
construct_domain = ConstructDomain(DomainStart=number_slider, DomainEnd=Slider(87, range=0..100))
list_length = ListLength(List=point)
random = Random(Range=construct_domain, Number=list_length, Seed=2)
graft_tree_2 = GraftTree(Tree=random, IncludeEmptyLists=True, IncludeNullItems=True)

circle_cnr = CircleCNR(Center=graft_tree, Normal=Vector(0, 0, 1), Radius=graft_tree_2)

scale = Scale(Geometry=circle_cnr, Center=Point(0, 0, 0), Factor=Slider(0.015, range=0..0.1))  # -> Geometry, Transform

circle_cnr_2 = CircleCNR(Center=graft_tree, Normal=Vector(0, 0, 1), Radius=scale.Geometry)
length = Length(Curve=circle_cnr)
evaluate_curve = EvaluateCurve(Curve=reparameterize(circle_cnr), Parameter=[Slider(0.812, range=0..1), Slider(0, range=0..1)])  # -> Point, Tangent, Angle
line = Line(StartPoint=graft_tree, EndPoint=evaluate_curve.Point)
trim_with_region = TrimWithRegion(Curve=line, Region=circle_cnr_2)  # -> Inside, Outside
curve = Curve(trim_with_region.Outside)

# ----
# transform the paths via randomised rotation
panel_3 = Panel("360")
list_length_2 = ListLength(List=point)
panel_4 = Panel(list_length_2)
random_2 = Random(Range=panel_3, Number=list_length_2, Seed="10")
shift_paths = ShiftPaths(Data=curve, Offset="-1")
graft_tree_3 = GraftTree(Tree=random_2, IncludeEmptyLists=True, IncludeNullItems=True)
rotate = Rotate(Geometry=shift_paths, Angle=degrees(graft_tree_3), Plane=graft_tree)  # -> Geometry, Transform
