# Grasshopper definition 20240730_Stairs.gh (Grasshopper 1.0.8)

# ----
# half arsed attempt before looking at tutorials
number_slider = Slider(0, range=0..360)
vector_xyz = VectorXYZ(XComponent=number_slider, YComponent=Slider(100, range=0..100), ZComponent=Slider(100, range=0..100))  # -> Vector, Length
point = Point(<point referenced from the Rhino model>)
adjust_plane = AdjustPlane(Plane=point, Normal=vector_xyz.Vector)
box = Box({Plane=Plane(origin=(0, 200, 0), x=(1, 0, 0), y=(0, -1, 0)), X=Domain(0, 500), Y=Domain(0, 200), Z=Domain(-50, 0)})
linear_array = LinearArray(Geometry=box, Direction=adjust_plane, Count=Slider(100, range=0..100))  # -> Geometry, Transform

panel = Panel("following a tutorial")
number_slider_2 = Slider(41, range=0..100)
plane = Plane(Plane(origin=(-279.9435916, 86.87717761, 0), x=(-0.1059995967, 0.9943661727, 0), y=(0.9943661727, 0.1059995967, 0)))
number_slider_3 = Slider(5, range=0..100)
number_slider_4 = Slider(40, range=0..100)
subtraction = Subtraction(A=number_slider_2, B=Slider(2, range=0..10))
rectangle = Rectangle(Plane=plane, XSize=Slider(99, range=0..100), YSize=number_slider_2, Radius=0)  # -> Rectangle, Length
unit_z = UnitZ(Factor=number_slider_3)
series = Series(Start=0, Step=subtraction, Count=number_slider_4)
surface = Surface(rectangle.Rectangle)
addition = Addition(A=number_slider_3, B=Slider(10, range=0..10))
extrude = Extrude(Base=surface, Direction=unit_z)
unit_x = UnitX(Factor=series)
series_2 = Series(Start=0, Step=addition, Count=number_slider_4)
move = Move(Geometry=extrude, Motion=unit_x)  # -> Geometry, Transform
unit_z_2 = UnitZ(Factor=series_2)
move_2 = Move(Geometry=move.Geometry, Motion=unit_z_2)  # -> Geometry, Transform
