# Grasshopper definition 20240730_Voronoi.ghx (Grasshopper 1.0.8)

panel = Panel("2D voronoi")
rectangle = Rectangle({Plane=PlaneXY(25, 25, 0), Size=Domain2(u=-25..25, v=-25..25)})
populate_2d = Populate2D(Region=rectangle, Count=Slider(248, range=0..1000), Seed=Slider(176, range=0..1000))
voronoi = Voronoi(Points=populate_2d, Boundary=rectangle, BruteForceOverride=False)

# ----
# baked. polysurfaces can be dragged out.
number_slider = Slider(8, range=0..10)
rectangle_2 = Rectangle(Plane=PlaneXY(0, 0, 0), XSize=number_slider, YSize=Slider(10, range=0..10), Radius=0)  # -> Rectangle, Length
box_rectangle = BoxRectangle(Rectangle=rectangle_2.Rectangle, Height=Slider(10, range=0..10))
box = Box(box_rectangle)
populate_3d = Populate3D(Region=box, Count=100, Seed=1)
voronoi_3d = Voronoi3D(Points=populate_3d, Box=box)  # -> Cells, Boundary
point = Point(Point(-25.52839175, 111.8216503, 0))
move = Move(Geometry=voronoi_3d.Cells, Motion=point)  # -> Geometry, Transform

panel_2 = Panel("parametric box dimensions")
rectangle_3 = Rectangle(Plane=PlaneXY(0, 0, 0), XSize=Slider(8, range=0..10), YSize=Slider(10, range=0..10), Radius=0)  # -> Rectangle, Length
box_rectangle_2 = BoxRectangle(Rectangle=rectangle_3.Rectangle, Height=Slider(10, range=0..10))
box_2 = Box(box_rectangle_2)
populate_3d_2 = Populate3D(Region=box_2, Count=100, Seed=1)
voronoi_3d_2 = Voronoi3D(Points=populate_3d_2, Box=box_2)  # -> Cells, Boundary
point_2 = Point(Point(82.29489433, 75.92005501, 0))
move_2 = Move(Geometry=voronoi_3d_2.Cells, Motion=point_2)  # -> Geometry, Transform
