# Grasshopper definition 20240805_Stairs.ghx (Grasshopper 1.0.8)

construct_domain = ConstructDomain(DomainStart=Slider(0, range=0..100), DomainEnd=Slider(10, range=0..10))
series = Series(Start="5", Step="5", Count="11")

# ----
# height of riser. point of tread.
# add expression (x-1) to steps.
range = Range(Domain=construct_domain, Steps=expr("x-1", "11"))

shortest_list = ShortestList(ListA=series, ListB=range, TrimMode=2)  # -> ListA, ListB

# ----
# retrives item from list with index of that item
list_item = ListItem(List=range, Index="2", Wrap=True)  # -> Item, Item1

subtraction = Subtraction(A=list_item.Item1, B=list_item.Item)
construct_point = ConstructPoint(XCoordinate=shortest_list.ListA, YCoordinate=0, ZCoordinate=shortest_list.ListB)

panel = Panel("height of riser")
unit_z = UnitZ(Factor=subtraction)

panel_2 = Panel("""0
1""")
move = Move(Geometry=construct_point, Motion=unit_z)  # -> Geometry, Transform
weave = Weave(Pattern=panel_2, Stream0=construct_point, Stream1=move.Geometry, NullGaps=False)
panel_3 = Panel(unit_z)

# ----
# get rid of the last two figures in the indices of numbers eg. 1 to 100, -1 and -2 would take away 99 and 98
panel_4 = Panel("""-1
-2
-3""")

cull_index = CullIndex(List=weave, Indices=panel_4, Wrap=True)

# ----
# drawing the actual polyline between the points
polyline = PolyLine(Vertices=cull_index, Closed=False)

point_list = PointList(Points=cull_index, Size=Slider(0.986, range=0..2))
point_order = PointOrder(Points=cull_index)
unit_y = UnitY(Factor=Slider(33, range=0..100))
extrude = Extrude(Base=polyline, Direction=unit_y)
