# Grasshopper definition 20240805_Warren Truss.ghx (Grasshopper 1.0.8)
# plug-ins: RhinoCodePluginGH

# ----
# make it produce even numbers for the truss to look like a truss
number_slider = Slider(14, range=0..20)

panel = Panel("top")
curve = Curve(<curve referenced from the Rhino model>)

panel_2 = Panel("bottom")
curve_2 = Curve(<curve referenced from the Rhino model>)

# ----
# GUID -> Curve input:
# Right click topFlange > Type Hints > Curve
ipy2 = IronPython2Script(topFlange=curve, bottomFlange=curve_2)  # -> out, trussWebs; inputs topFlange: Curve, bottomFlange: Curve
# ---------- ipy2: IronPython ----------
#Point A
import ghpythonlib.components as ghc

#Point B
#Divide the line of truss. False will divide the curve not accounting for kinks.
trussDivision = 20
topPoints = ghc.DivideCurve(topFlange,trussDivision, False)
bottomPoints = ghc.DivideCurve(bottomFlange,trussDivision, False)

#Point C
#Defining topPoints and bottomPoints as a dictionary. [False, True] as the pattern.
#Note on dictionaries: not alphabetical
topPoints = ghc.Dispatch(topPoints["points"], [False, True])
bottomPoints = ghc.Dispatch(bottomPoints["points"], [False, True])

#Point D : Weave 
trussPoints = ghc.Weave([0,1], topPoints["list_b"], bottomPoints["list_a"])

trussWebs = ghc.PolyLine(trussPoints, False)
# ---------- end ipy2 ----------

py3 = Python3Script(topFlange=curve, bottomFlange=curve_2)  # -> out, a; inputs topFlange: Curve, bottomFlange: Curve
# ---------- py3: Python ----------
#definingvariables
string = "Text"
integer = 1
floatNumber = 1.0
array =[0,1,2,3]
dictionary = {"architect":"The value."}
complexDictonary = {"a":[0,1,2]}

#SUM(A5:A9)
#where SUM=function and A5:A9=arguments. RETURN=output
#divide inputs with commas

additionResult=integer+floatNumber

print(additionResult)
print(string)

#--------------------------------------
#importing and giving it a nickname 
import rhinoscriptsyntax as rs 
import ghpythonlib.components as ghc

#--------------------------------------
#prints the ID of topFlange
print(topFlange)

#--------------------------------------
#divide the line of truss
trussDivision = 10
topPoints = ghc.DivideCurve(topFlange,trussDivision, False)
print(topPoints)
# ---------- end py3 ----------
divide_curve = DivideCurve(Curve=curve_2, Count=number_slider, Kinks=False)  # -> Points, Tangents, Parameters
divide_curve_2 = DivideCurve(Curve=curve, Count=number_slider, Kinks=False)  # -> Points, Tangents, Parameters
panel_3 = Panel("""0
1""")
panel_4 = Panel(ipy2.trussWebs)
crv = Curve(ipy2.trussWebs)
dispatch = Dispatch(List=divide_curve_2.Points, DispatchPattern=panel_3)  # -> ListA, ListB

# ----
# similar to weave but opposite.
# takes booleans (true or false, 0 or 1 where 0=false any other number is true)
# gives alternating points (B,A,B,A...)
dispatch_2 = Dispatch(List=divide_curve.Points, DispatchPattern=panel_3)  # -> ListA, ListB

# ----
# connect points from line A to x+1 of line B
panel_5 = Panel("""True 
False""")

# ----
# vertical lines between points
line = Line(StartPoint=divide_curve_2.Points, EndPoint=divide_curve.Points)

point = Point(dispatch.ListA)
point_2 = Point(dispatch_2.ListB)
boolean = Boolean(panel_5)

# ----
# 0 = false
# false = B
# false = stream 0
weave = Weave(Pattern=panel_3, Stream0=point_2, Stream1=point, NullGaps=False)

integer = Integer(boolean)
panel_6 = Panel(integer)
polyline = PolyLine(Vertices=weave, Closed=False)
