# Grasshopper definition 20240812_Stairs.gh (Grasshopper 1.0.8)

number_slider = Slider(32, range=0..100)
construct_domain = ConstructDomain(DomainStart=Slider(3, range=0..10), DomainEnd=Slider(10, range=0..10))
series = Series(Start=Slider(8, range=0..10), Step=Slider(3, range=0..10), Count=number_slider)
range = Range(Domain=construct_domain, Steps=number_slider)
list_item = ListItem(List=range, Index="0", Wrap=True)  # -> Item, Item1
shortest_list = ShortestList(ListListA=series, ListListB=range, TrimMode=2)  # -> ListListA, ListListB
subtraction = Subtraction(A=list_item.Item1, B=list_item.Item)
construct_point = ConstructPoint(XCoordinate=shortest_list.ListListA, YCoordinate=0, ZCoordinate=shortest_list.ListListB)
panel = Panel(subtraction)
unit_z = UnitZ(Factor=subtraction)
panel_2 = Panel("""0
1""")
move = Move(Geometry=construct_point, Motion=unit_z)  # -> Geometry, Transform
weave = Weave(Pattern=panel_2, Stream0=construct_point, Stream1=move.Geometry, NullGaps=False)
panel_3 = Panel(unit_z)
panel_4 = Panel("""-1
-2""")
point_order = PointOrder(Points=weave)
point_list = PointList(Points=weave, Size=move.Geometry)
cull_index = CullIndex(List=weave, Indices=panel_4, Wrap=True)
polyline = PolyLine(Vertices=cull_index, Closed=False)

# ----
# I drew the stairs on XZ instead of XY, hence adding in XZ plane
xz_plane = XZPlane(Origin=Point(0, 0, 0))

bounding_box = BoundingBox(Content=cull_index, Plane=PlaneXY(0, 0, 0), UnionBox=True)  # -> Box, Box_2
panel_5 = Panel(bounding_box.Box)
deconstruct_box = DeconstructBox(Box=bounding_box.Box)  # -> Plane, X, Y, Z
plane_surface = PlaneSurface(Plane=xz_plane, XSize=deconstruct_box.X, YSize=deconstruct_box.Z)

surface_closest_point = SurfaceClosestPoint(Point=cull_index, Surface=reparameterize(plane_surface))  # -> Point, UVPoint, Distance
panel_6 = Panel(surface_closest_point.UVPoint)

unit_z_2 = UnitZ(Factor=Slider(20, range=0..100))
curve = Curve(<curve referenced from the Rhino model>)
unit_z_3 = UnitZ(Factor=Slider(20, range=0..100))
curve_2 = Curve(<curve referenced from the Rhino model>)
extrude = Extrude(Base=curve, Direction=unit_z_2)
extrude_2 = Extrude(Base=curve_2, Direction=unit_z_3)
evaluate_surface = EvaluateSurface(Surface=reparameterize(extrude), Point=surface_closest_point.UVPoint)  # -> Point, Normal, UDirection, VDirection, Frame
evaluate_surface_2 = EvaluateSurface(Surface=reparameterize(extrude_2), Point=surface_closest_point.UVPoint)  # -> Point, Normal, UDirection, VDirection, Frame
polyline_2 = PolyLine(Vertices=evaluate_surface_2.Point, Closed=False)
polyline_3 = PolyLine(Vertices=evaluate_surface.Point, Closed=False)

# ----
# Make stairs curved instead of straight
pull_curve = PullCurve(Curve=polyline_2, Surface=extrude_2)

loft = Loft(
    Curves=[pull_curve, polyline_3],
    Options={Adjust=False, Closed=False, LoftEnds=0, LoftSimp=0, LoftType=0, Rebuild=10, Refit=0.01})
