# Grasshopper definition 20240819_Iteration 1.gh (Grasshopper 1.0.8)
# plug-ins: Pufferfish

number_slider = Slider(97, range=0..1000)
addition = Addition(A=number_slider, B=Slider(89, range=0..100))
circle = Circle(Plane=PlaneXY(0, 0, 0), Radius=number_slider)
offset_curve = OffsetCurve(Curve=circle, Distance=addition, Corners=1)
divide_curve = DivideCurve(Curve=offset_curve, Count=Slider(20, range=0..20), Kinks=False)  # -> Points, Tangents, Parameters
dispatch = Dispatch(List=divide_curve.Points, DispatchPattern=[True, False])  # -> ListA, ListB
multiplication = Multiplication(A=number_slider, B=Slider(7, range=0..10))
points_trim_curve = PointsTrimCurve(Curve=offset_curve, Points=divide_curve.Points, Flip="1")  # -> Trimmed, SubDomains, Intersected
line = Line(StartPoint=dispatch.ListA, EndPoint=dispatch.ListB)
end_points = EndPoints(Curve=flatten(line))  # -> Start, End
offset_curve_2 = OffsetCurve(Curve=line, Distance=Slider(100, range=0..100), Corners=1)  # -> flatten(Curve)
end_points_2 = EndPoints(Curve=flatten(offset_curve_2))  # -> Start, End
line_2 = Line(StartPoint=end_points_2.Start, EndPoint=end_points.Start)
line_3 = Line(StartPoint=end_points_2.End, EndPoint=end_points.End)
merge = Merge(Data1=flatten(points_trim_curve.Trimmed), Data2=flatten(offset_curve_2), Data3=flatten(line_3), Data4=flatten(line_2))
number_slider_2 = Slider(2.724, range=0..5)
join_curves = JoinCurves(Curves=merge, Preserve=False)
subtraction = Subtraction(A=Slider(0, range=0..1), B=number_slider_2)
rotate = Rotate(Geometry=join_curves, Angle=subtraction, Plane=PlaneXY(0, 0, 0))  # -> Geometry, Transform
number = Number(multiplication)
rotate_2 = Rotate(Geometry=join_curves, Angle=number_slider_2, Plane=PlaneXY(0, 0, 0))  # -> Geometry, Transform
boundary_surfaces = BoundarySurfaces(Edges=rotate_2.Geometry)
boundary_surfaces_2 = BoundarySurfaces(Edges=rotate.Geometry)
surface_split = SurfaceSplit(Surface=boundary_surfaces, Curves=circle)
surface_split_2 = SurfaceSplit(Surface=boundary_surfaces_2, Curves=circle)
list_item = ListItem(List=surface_split, Index=0, Wrap=True)
unit_z = UnitZ(Factor=Slider(100, range=0..100))
list_item_2 = ListItem(List=surface_split_2, Index=0, Wrap=True)
extrude = Extrude(Base=list_item, Direction=unit_z)
extrude_2 = Extrude(Base=list_item_2, Direction=unit_z)
unit_x = UnitX(Factor=number)
move = Move(Geometry=extrude_2, Motion=unit_x)  # -> flatten(Geometry), Transform
