# Grasshopper definition 20240909_Karangaroo Testing.gh (Grasshopper 1.0.8)
# plug-ins: Kangaroo2 Components

mplane = MeshPlane(Boundary={Plane=PlaneXY(0, 0, 0), Size=Domain2(u=-10..10, v=-10..10)}, WidthCount=10, HeightCount=10)  # -> Mesh, Area
demesh = DeconstructMesh(Mesh=mplane.Mesh)  # -> Vertices, Faces, Colours, Normals
pt = Point([<point referenced from the Rhino model> x4])
nv = NakedVertices(Mesh=mplane.Mesh)  # -> ClothedIndex, NakedIndex, ClothedPts, NakedPts
cp = ClosestPoint(Point=pt, Cloud=demesh.Vertices)  # -> ClosestPoint, CPIndex, Distance
faceb = FaceBoundaries(Mesh=mplane.Mesh)

# ----
# uses a point in the simulation as an anchor
anchor = Anchor(Point=cp.ClosestPoint, Strength=10000)

pressure = Pressure(M=mplane.Mesh, Strength=1)
panel = Panel("inflation")

load = Load(Point=demesh.Vertices, ForceVector=Vector(0, 0, 1), Weighting=1)

# ----
# scale the length by a factor. like scale1D in rhino.
edgelengths = EdgeLengths(Mesh=faceb, LengthFactor=Slider(0.054, range=0..1), Strength=1)

merge = Merge(Data1=edgelengths, Data2=anchor, Data3=load, Data4=pressure)
stepsolver = StepSolver(
    GoalObjects=flatten(merge),
    Tolerance=0.0001,
    Momentum=False,
    Damping=0.99,
    SubIterations="1",
    Animate=Slider(100, range=0..100))  # -> I, V, O
bang = ExplodeTree(Data=stepsolver.O)  # -> Branch0, Branch1
