# Grasshopper definition 20240909_Topography and Site.gh (Grasshopper 1.0.8)
# plug-ins: Human

# ----
# Uses points in default layer. Just make sure the layer referenced is the layer with the points.
panel = Panel("Point")

dpipeline = DynamicGeometryPipeline(
    LayerFilter="Default",
    TypeFilter=panel,
    NameFilter="*",
    GroupByLayer=False,
    GroupByType=False,
    IncludeHidden=True,
    IncludeLocked=True,
    enableFullPath=False,
    listenToAttributes=True)
del = DelaunayMesh(Points=dpipeline, Plane=PlaneXY(0, 0, 0))
faceb = FaceBoundaries(Mesh=del)
explode = Explode(Curve=faceb, Recursive=True)  # -> Segments, Vertices
fcircle = CircleFit(Points=explode.Vertices)  # -> Circle, Radius, Deviation
