# Grasshopper definition 20240916_Redback 2.gh (Grasshopper 1.0.8)
# plug-ins: Redback-Beta.GH

panel = Panel("""Default
Layer 01
Layer 02""")

# ----
# how to reference layers in rhino. can also use [dyanmic geometry pipeline] or [reference by layer]
query_model_objects = QueryModelObjects(Layer=panel, Locked=True, Hidden=True, AutoUpdateState=True)

# ----
# set view and internalise data to save the view of make 2D
view = View(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, ViewSource=1)

model_object = ModelObject(Object=query_model_objects)  # -> Object, Geometry, Layer
model_layer = ModelLayer(Layer=model_object.Layer)  # -> Layer, Name
curve = Curve(model_object.Geometry)

# ----
# to draw any advanced curves
curve_to_polyline = CurveToPolyline(Curve=curve, ToleranceDistance=0.1, ToleranceAngle=0)  # -> Polyline, Segments

css = Panel("""*{
fill: #e78787;
stroke: #6d2323;
stroke-width: 0.2mm;
stroke-linecap: round;
stroke-linejoin: round;
}
[layer="Default"]{
stroke: #2d1414;
stroke-width:0.1mm;
}
[layer="Layer 01"]{
stroke-dasharray: 0.5mm 0.5mm;
fill: none;
}
[layer="Layer 02"]{
stroke: #2d1414;
fill: #2d1414;
}""")
graft_tree = GraftTree(Tree=model_layer.Name, IncludeEmptyLists=True, IncludeNullItems=True)

list_item = ListItem(List=model_layer.Name, Index=0, Wrap=True)
panel_2 = Panel(list_item)
replace_text = ReplaceText(Text="svgoutput_#.svg", Find="#", Replace=list_item, RecursiveReplace=False)

xy_plane = XYPlane(Origin=Point(0, 0, 0))
svg_layout = SVGLayout(Plane=xy_plane, Dimensions="A4 (L)", Scale="1:100", Location=Toggle(True))  # -> L, R

cylinder = Cylinder(Base=PlaneXY(0, 0, 0), Radius=0.5, Length=1)
query_viewports = QueryViewports(AutoUpdateState=True)
scale = Scale(Geometry=cylinder, Center=Point(0, 0, 0), Factor=Slider(6787, range=0..10000))  # -> Geometry, Transform
list_item_2 = ListItem(List=query_viewports, Index=0, Wrap=True)
make2d = Make2D(Geometry=scale.Geometry, View=view, TangentEdges=False, TangentSeams=False, AutoComputeMake2D=False)  # -> VisibleCurves, VisibleIndex, VisibleType, HiddenCurves, HiddenIndex, HiddenType
geo2arch = Geo2Arch(Geometry=make2d.VisibleCurves, Properties="{}")
svg_generator = SVGGenerator(JO=geo2arch, LA=svg_layout.L, CSS=css)

create_json = CreateJSON(Keys="layer", Values=graft_tree)

# ----
# The SVG layout parameters
boolean_toggle = BooleanToggle(True)
xy_plane_2 = XYPlane(Origin=Point(0, 0, 0))
svg_layout_2 = SVGLayout(Plane=xy_plane_2, Dimensions="A4 (L)", Scale="1:100", Location=boolean_toggle)  # -> L, R

unflatten_tree = UnflattenTree(Tree=create_json, Guide=curve_to_polyline.Polyline)
geo2arch_2 = Geo2Arch(Geometry=curve_to_polyline.Polyline, Properties=unflatten_tree)
panel_3 = Panel(create_json)

# ----
# will always point back to the location of the rhino file. is dynamic.
panel_4 = Panel("svgoutput.svg")

# ----
# what the file will be saved as
panel_5 = Panel("pictureoutput.svg")

construct_point = ConstructPoint(XCoordinate=0, YCoordinate=0, ZCoordinate=0)
surface = Surface(<surface referenced from the Rhino model>)
evaluate_surface = EvaluateSurface(Surface=surface, Point=construct_point)  # -> Point, Normal, UDirection, VDirection, Frame
bounding_box = BoundingBox(Content=surface, Plane=evaluate_surface.Frame)  # -> Box, Box_2
deconstruct_box = DeconstructBox(Box=bounding_box.Box)  # -> Plane, X, Y, Z
panel_6 = Panel("C:\Users\syin0735\Documents\GitHub\ARCHIPUNK---SOPHIA\macquarie point.png")
rectangle = Rectangle(Plane=deconstruct_box.Plane, XSize=deconstruct_box.X, YSize=deconstruct_box.Y, Radius=0)  # -> Rectangle, Length
image_object = ImageObject(RE=rectangle.Rectangle, ImagePath=panel_6)
geo2arch_3 = Geo2Arch(Geometry=image_object, Properties="{}")
svg_generator_2 = SVGGenerator(JO=geo2arch_3, LA=svg_layout_2.L)
relative_path = RelativePath(Path=Toggle(False), RelativePath=panel_5)  # -> FullPath, Directory, FileName
write_file = WriteFile(Run=Toggle(True), Content=svg_generator_2, FileDirectory=relative_path.Directory, FileName=relative_path.FileName)

# ----
# true = rhino file
# false = grasshopper file
boolean_toggle_2 = BooleanToggle(False)

svg_generator_3 = SVGGenerator(JO=geo2arch_2, LA=svg_layout.L, CSS=css)

relative_path_2 = RelativePath(Path=boolean_toggle_2, RelativePath=panel_4)  # -> FullPath, Directory, FileName
panel_7 = Panel(relative_path_2.FileName)
write_file_2 = WriteFile(Run=Toggle(True), Content=svg_generator, FileDirectory=relative_path_2.Directory, FileName=relative_path_2.FileName)

# ----
# to merge objects into one photoshop layer
mergearchjson = MergeArchJSON()

# ----
# will always point back to the location of the rhino file. is dynamic.
panel_8 = Panel("svgoutput.svg")

# ----
# true = rhino file
# false = grasshopper file
boolean_toggle_3 = BooleanToggle(False)

relative_path_3 = RelativePath(Path=boolean_toggle_3, RelativePath=replace_text)  # -> FullPath, Directory, FileName
panel_9 = Panel(relative_path_3.FileName)
write_file_3 = WriteFile(Run=Toggle(True), Content=svg_generator_3, FileDirectory=relative_path_3.Directory, FileName=relative_path_3.FileName)

panel_10 = Panel(write_file_2)
panel_11 = Panel(write_file_3)
