# Grasshopper definition 20240916_Redback.gh (Grasshopper 1.0.8)
# plug-ins: Redback-Beta.GH

panel = Panel("""Default
Layer 01
Layer 02""")

# ----
# set view and internalise data to save the view of make 2D
view = View(<view referenced from the Rhino model>, ViewSource=1)

# ----
# how to reference layers in rhino. can also use [dyanmic geometry pipeline] or [reference by layer]
query_model_objects = QueryModelObjects(Layer=panel, Locked=True, Hidden=True, AutoUpdateState=True)

model_object = ModelObject(Object=query_model_objects)  # -> Object, Geometry, Layer
model_layer = ModelLayer(Layer=model_object.Layer)  # -> Layer, Name
curve = Curve(model_object.Geometry)

xy_plane = XYPlane(Origin=Point(0, 0, 0))
svg_layout = SVGLayout(Plane=xy_plane, Dimensions="A4 (L)", Scale="1:100", Location=Toggle(True))  # -> L, R

# ----
# to draw any advanced curves
curve_to_polyline = CurveToPolyline(Curve=curve, ToleranceDistance=0.1, ToleranceAngle=0)  # -> Polyline, Segments

css = Panel("""*{
fill: #e78787;
stroke: #6d2323;
stroke-width: 0.2mm;
stroke-linecap: round;
stroke-linejoin: round;
}
[layer="Default"]{
stroke: #2d1414;
stroke-width:0.1mm;
}
[layer="Layer 01"]{
stroke-dasharray: 0.5mm 0.5mm;
fill: none;
}
[layer="Layer 02"]{
stroke: #2d1414;
fill: #2d1414;
}""")

cylinder = Cylinder(Base=PlaneXY(0, 0, 0), Radius=0.5, Length=1)
query_viewports = QueryViewports(AutoUpdateState=True)
scale = Scale(Geometry=cylinder, Center=Point(0, 0, 0), Factor=Slider(6787, range=0..10000))  # -> Geometry, Transform
list_item = ListItem(List=query_viewports, Index=0, Wrap=True)
make2d = Make2D(Geometry=scale.Geometry, View=view, TangentEdges=False, TangentSeams=False, AutoComputeMake2D=False)  # -> VisibleCurves, VisibleIndex, VisibleType, HiddenCurves, HiddenIndex, HiddenType
geo2arch = Geo2Arch(Geometry=flatten(make2d.VisibleCurves), Properties=flatten("{}"))
svg_generator = SVGGenerator(JO=geo2arch, LA=svg_layout.L, CSS=css)

graft_tree = GraftTree(Tree=model_layer.Name, IncludeEmptyLists=True, IncludeNullItems=True)
create_json = CreateJSON(Keys="layer", Values=graft_tree)
geo2arch_2 = Geo2Arch(Geometry=flatten(curve_to_polyline.Polyline), Properties=flatten(create_json))
panel_2 = Panel(create_json)
svg_generator_2 = SVGGenerator(JO=geo2arch_2, LA=svg_layout.L, CSS=css)

# ----
# will always point back to the location of the rhino file. is dynamic.
panel_3 = Panel("svgoutput.svg")

# ----
# true = rhino file
# false = grasshopper file
boolean_toggle = BooleanToggle(False)

# ----
# will always point back to the location of the rhino file. is dynamic.
panel_4 = Panel("svgoutput.svg")

# ----
# true = rhino file
# false = grasshopper file
boolean_toggle_2 = BooleanToggle(False)

relative_path = RelativePath(Path=boolean_toggle, RelativePath=panel_3)  # -> FullPath, Directory, FileName
panel_5 = Panel(relative_path.FileName)
write_file = WriteFile(Run=Toggle(True), Content=svg_generator, FileDirectory=relative_path.Directory, FileName=relative_path.FileName)

relative_path_2 = RelativePath(Path=boolean_toggle_2, RelativePath=panel_4)  # -> FullPath, Directory, FileName
panel_6 = Panel(relative_path_2.FileName)
write_file_2 = WriteFile(Run=Toggle(True), Content=svg_generator_2, FileDirectory=relative_path_2.Directory, FileName=relative_path_2.FileName)

# ----
# to merge objects into one photoshop layer
mergearchjson = MergeArchJSON()

panel_7 = Panel(write_file)
panel_8 = Panel(write_file_2)
