# Grasshopper definition 20241110_Karamba Testing.gh (Grasshopper 1.0.8)
# plug-ins: Karamba3D, GhPolyhedra, Weaverbird, Kangaroo2 Components

panel = Panel("geodesic dome")
pt = Point(Point(-38, 9, 0))

number_slider = Slider(19703, range=0..20000)
# tethering the cutting surface to the point where dome is created
multiplication = Multiplication(A=number_slider, B="-0.5")
unit_x = UnitX(Factor=multiplication)
unit_y = UnitY(Factor=multiplication)
move = Move(Geometry=pt, Motion=unit_x)  # -> Geometry, Transform
move_2 = Move(Geometry=move.Geometry, Motion=unit_y)  # -> Geometry, Transform
plane_surface = PlaneSurface(Plane=move_2.Geometry, XSize=number_slider, YSize=number_slider)

element = ElementKaramba3D()
Z = UnitZ(Factor=1)
multiplication_2 = Multiplication(A=Z, B="-50")
crv = Curve([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])
pt_2 = Point([Point(55.29420852, 33.23567213, 16.68860984), Point(61.34447674, 33.23567213, 16.68860984), Point(58.33708844, 33.23567213, 19.64615193), Point(63.98688612, 33.23567213, 19.64615193), Point(52.39664932, 33.23567213, 19.64615193)])
matselect = MaterialSelectionKaramba3D(NameOrListIndexOfMaterial="S235 # Steel", menu=[dropdown(0), dropdown(0)])
linetobeam = LineToBeamKaramba3D(
    Line=crv,
    New=True,
    Remove=True,
    LimitDistance_m=0.005,
    Bending=True,
    SetBucklingLength=True,
    ToPolylineMaxAngle=0.03,
    ToPolylineTolerance=0.01,
    ToPolylineMaxEdgeLength=0.25)  # -> Element, Points, Info
loads = LoadsKaramba3D(Vector=multiplication_2, LCase="0", mode="Gravity")
pt_3 = Point([<point referenced from the Rhino model> x2])
supp = SupportKaramba3D(PosInd=pt_3, menu=[buttons(on, on, on, on, on, on)])
crosecselect = CrossSectionSelectorKaramba3D(NameOrListIndexOfCrossSection="CHSH244.5x25.0")  # -> CrossSection, Info
assemble = AssembleModelKaramba3D(
    Point=pt_2,
    Elem=linetobeam.Element,
    Support=supp,
    Load=loads,
    CrossSection=crosecselect.CrossSection,
    Material=matselect,
    LimitDistance_m=0.005)  # -> Model, Info, Mass_kg, CenterOfGravity, LoadCaseNames
model = ModelKaramba3D(assemble.Model)
analyze = AnalyzeKaramba3D(Model=model)  # -> CalculatedModel, MaximumDisplacement_cm, ResultingForceOfGravity_kN, ElasticEnergyChange_kNm
modelview = ModelViewKaramba3D(Model=analyze.CalculatedModel, ResultFactors=1, ResultCase=-1)  # -> Model, DeformedMesh, DeformedAxes, DeformedModel
beamview = BeamViewKaramba3D(Model=modelview.Model)  # -> Model, MeshesOfRenderedBeams, DeformedBeamAxes, LegendColors, LegendTags

radius = Slider(5000, range=0..5000)
xz = XZPlane(Origin=pt)
icosphere = IcoSphere(Plane=xz, Scale=radius, Density=Slider(2, range=0..5))
face_boundaries = FaceBoundaries(Mesh=icosphere)
boundary_surfaces = BoundarySurfaces(Edges=face_boundaries)
brep_join = BrepJoin(Breps=boundary_surfaces)  # -> Breps, Closed
brep = Brep(brep_join.Breps)
split_brep = SplitBrep(Brep=brep, Cutter=plane_surface)
dispatch = Dispatch(List=split_brep, DispatchPattern=[True, False])  # -> ListA, ListB
brep_2 = Brep(dispatch.ListA)

element_2 = ElementKaramba3D()
Z_2 = UnitZ(Factor=1)
multiplication_3 = Multiplication(A=Z_2, B="-50")
crv_2 = Curve([<curve referenced from the Rhino model> x1369])
pt_4 = Point([<point referenced from the Rhino model> x2738])
matselect_2 = MaterialSelectionKaramba3D(NameOrListIndexOfMaterial="S235 # Steel", menu=[dropdown(0), dropdown(0)])
loads_2 = LoadsKaramba3D(Vector=multiplication_3, LCase="0", mode="Gravity")
pt_5 = Point([<point referenced from the Rhino model> x332])
linetobeam_2 = LineToBeamKaramba3D(
    Line=crv_2,
    New=True,
    Remove=True,
    LimitDistance_m=0.005,
    Bending=True,
    SetBucklingLength=True,
    ToPolylineMaxAngle=0.03,
    ToPolylineTolerance=0.01,
    ToPolylineMaxEdgeLength=0.25)  # -> Element, Points, Info
supp_2 = SupportKaramba3D(PosInd=pt_5, menu=[buttons(on, on, on, on, on, on)])
crosecselect_2 = CrossSectionSelectorKaramba3D(NameOrListIndexOfCrossSection="CHSH244.5x25.0")  # -> CrossSection, Info
assemble_2 = AssembleModelKaramba3D(
    Point=pt_4,
    Elem=linetobeam_2.Element,
    Support=supp_2,
    Load=loads_2,
    CrossSection=crosecselect_2.CrossSection,
    Material=matselect_2,
    LimitDistance_m=0.005)  # -> Model, Info, Mass_kg, CenterOfGravity, LoadCaseNames
model_2 = ModelKaramba3D(assemble_2.Model)
analyze_2 = AnalyzeKaramba3D(Model=model_2)  # -> CalculatedModel, MaximumDisplacement_cm, ResultingForceOfGravity_kN, ElasticEnergyChange_kNm
modelview_2 = ModelViewKaramba3D(Model=analyze_2.CalculatedModel, ResultFactors=1, ResultCase=-1)  # -> Model, DeformedMesh, DeformedAxes, DeformedModel
beamview_2 = BeamViewKaramba3D(Model=modelview_2.Model)  # -> Model, MeshesOfRenderedBeams, DeformedBeamAxes, LegendColors, LegendTags

panel_2 = Panel("for karamba ")
addition = Addition(A=Slider(400, range=0..5000), B=radius)

icosphere_2 = IcoSphere(Plane=xz, Scale=addition, Density=Slider(3, range=0..5))
face_boundaries_2 = FaceBoundaries(Mesh=icosphere_2)
boundary_surfaces_2 = BoundarySurfaces(Edges=face_boundaries_2)
brep_join_2 = BrepJoin(Breps=boundary_surfaces_2)  # -> Breps, Closed
brep_3 = Brep(brep_join_2.Breps)
split_brep_2 = SplitBrep(Brep=brep_3, Cutter=plane_surface)
dispatch_2 = Dispatch(List=split_brep_2, DispatchPattern=[True, False])  # -> ListA, ListB
brep_4 = Brep(dispatch_2.ListA)

sphere = Sphere(Base=xz, Radius=addition)
split_brep_3 = SplitBrep(Brep=sphere, Cutter=plane_surface)
dispatch_3 = Dispatch(List=split_brep_3, DispatchPattern=[True, False])  # -> ListA, ListB
brep_5 = Brep(dispatch_3.ListA)
brep_edges = BrepEdges(Brep=brep_2)  # -> Naked, Interior, NonManifold
brep_edges_2 = BrepEdges(Brep=brep_4)  # -> Naked, Interior, NonManifold
area = Area(Geometry=brep_2)  # -> Area, Centroid
area_2 = Area(Geometry=brep_4)  # -> Area, Centroid
merge = Merge(Data1=brep_edges.Naked, Data2=brep_edges.Interior)
weaverbird_s_mesh_from_lines_weave_back = WeaverbirdsMeshFromLinesWeaveBack(MaximumValence=4)
end_points = EndPoints(Curve=merge)  # -> Start, End
weaverbird_s_picture_frame = WeaverbirdsPictureFrame(MeshPolylines=weaverbird_s_mesh_from_lines_weave_back, Distance=Slider(3, range=0..10), InsetType=0)
subtraction = Subtraction(A=Slider(0, range=0..100), B=Slider(20, range=0..50))
weaverbird_s_mesh_thicken = WeaverbirdsMeshThicken(MeshCurves=weaverbird_s_picture_frame, Distance=subtraction, OffsetType=0)
extend_curve = Slider(0, range=0..200)
negative = Negative(Value=extend_curve)
pipe_thickness = Slider(41, range=0..50)
pipe = Pipe(Radius=pipe_thickness, Caps=0)
pipe_2 = Pipe(Radius=Slider(36, range=0..100), Caps=0)
addition_2 = Addition(A=Slider(10, range=0..10), B=pipe_thickness)

explode = Explode(Curve=[brep_edges_2.Naked, brep_edges_2.Interior], Recursive=True)  # -> flatten(Segments), Vertices
extend_curve_2 = ExtendCurve(Curve=merge, Type=0, Start=negative, End=negative)

end_points_2 = EndPoints(Curve=extend_curve_2)  # -> Start, End
# EXTRUDE LINE VIA NORMAL TO ACT AS MEMBERS FOR THE EXTERNAL LAYER
line = Line(StartPoint=end_points.Start, EndPoint=end_points_2.Start)
line_2 = Line(StartPoint=end_points.End, EndPoint=end_points_2.End)
merge_2 = Merge(Data1=line, Data2=line_2)
mp = MultiPipe(Curves=merge_2, NodeSize=addition_2, EndOffset=1, StrutSize=1, Segment=0, KinkAngle=0.6, CubeFit=0)

deconstruct_brep = DeconstructBrep()  # -> Faces, Edges, Vertices
boundary_surfaces_3 = BoundarySurfaces(Edges=deconstruct_brep.Faces)

area_3 = Area(Geometry=boundary_surfaces_3)  # -> Area, Centroid

deconstruct_brep_2 = DeconstructBrep(Brep=brep_2)  # -> Faces, Edges, Vertices
fillet = Fillet(Curve=deconstruct_brep_2.Faces, Radius=Slider(0.713, range=0..1))
boundary_surfaces_4 = BoundarySurfaces(Edges=fillet)
# connect last - makes model slow
number_slider_2 = Slider(0.907, range=0..1)

point = Point(deconstruct_brep_2.Vertices)
pull_point = PullPoint(Point=point, Geometry=brep_5, ClosestOnly=True)  # -> ClosestPoint, Distance

line_3 = Line(StartPoint=point, EndPoint=pull_point.ClosestPoint)
end = EndPoints(Curve=[extend_curve_2, explode.Segments, line_3])  # -> Start, End

area_4 = Area(Geometry=boundary_surfaces_4)  # -> Area, Centroid

line_4 = Line(StartPoint=area_2.Centroid, EndPoint=area_3.Centroid)
amplitude = Amplitude(Vector=line_4, Amplitude=Slider(0.823, range=0..10))
move_3 = Move(Geometry=boundary_surfaces_3, Motion=amplitude)  # -> Geometry, Transform

area_5 = Area(Geometry=move_3.Geometry)  # -> Area, Centroid

scale = Scale(Geometry=move_3.Geometry, Center=area_5.Centroid, Factor=Slider(0.9, range=0..1))  # -> Geometry, Transform
boundary_surfaces_5 = BoundarySurfaces(Edges=scale.Geometry)

line_5 = Line(StartPoint=area.Centroid, EndPoint=area_4.Centroid)
amplitude_2 = Amplitude(Vector=line_5, Amplitude=Slider(0.823, range=0..10))
move_4 = Move(Geometry=boundary_surfaces_4, Motion=amplitude_2)  # -> Geometry, Transform

area_6 = Area(Geometry=move_4.Geometry)  # -> Area, Centroid

scale_2 = Scale(Geometry=move_4.Geometry, Center=area_6.Centroid, Factor=number_slider_2)  # -> Geometry, Transform
boundary_surfaces_6 = BoundarySurfaces(Edges=scale_2.Geometry)
