# Grasshopper definition 20241110_Karamba Testing.gh (Grasshopper 1.0.8)
# plug-ins: Karamba3D

element = ElementKaramba3D()
Z = UnitZ(Factor=1)
material_selection_karamba3d = MatSelect(NameOrListIndexOfMaterial="S235 # Steel", menu=[dropdown(0), dropdown(0)])
multiplication = Multiplication(A=Z, B="-50")
crv = Curve([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])
line_to_beam_karamba3d = LineToBeam(
    Line=crv,
    New=True,
    Remove=True,
    LimitDistance_m=0.005,
    Bending=True,
    SetBucklingLength=True,
    ToPolylineMaxAngle=0.03,
    ToPolylineTolerance=0.01,
    ToPolylineMaxEdgeLength=0.25)  # -> Element, Points, Info
pt = Point([Point(55.29420852, 33.23567213, 16.68860984), Point(61.34447674, 33.23567213, 16.68860984), Point(58.33708844, 33.23567213, 19.64615193), Point(63.98688612, 33.23567213, 19.64615193), Point(52.39664932, 33.23567213, 19.64615193)])
loads_karamba3d = Loads(Vector=multiplication, LCase="0", mode="Gravity")
pt_2 = Point([Point(63.98688612, 33.23567213, 19.64615193), Point(52.39664932, 33.23567213, 19.64615193)])
cross_section_selector_karamba3d = CroSecSelect(NameOrListIndexOfCrossSection="CHSH244.5x25.0")  # -> CrossSection, Info
support_karamba3d = Supp(PosInd=pt_2, menu=[buttons(on, on, on, on, on, on)])
assemble_model_karamba3d = Assemble(
    Point=pt,
    Elem=line_to_beam_karamba3d.Element,
    Support=support_karamba3d,
    Load=loads_karamba3d,
    CrossSection=cross_section_selector_karamba3d.CrossSection,
    Material=material_selection_karamba3d,
    LimitDistance_m=0.005)  # -> Model, Info, Mass_kg, CentreOfGravity, LoadCaseNames
model = ModelKaramba3D(assemble_model_karamba3d.Model)
analyze_karamba3d = Analyze(Model=model)  # -> CalculatedModel, MaximumDisplacement_cm, ResultingForceOfGravity_kN, ElasticEnergyChange_kNm
model_view_karamba3d = ModelView(Model=analyze_karamba3d.CalculatedModel, ResultFactors=1, ResultCase=-1)  # -> Model, DeformedMesh, DeformedAxes, DeformedModel
beam_view_karamba3d = BeamView(Model=model_view_karamba3d.Model)  # -> Model, MeshesOfRenderedBeams, DeformedBeamAxes, LegendColours, LegendTags

panel = Panel(analyze_karamba3d.ResultingForceOfGravity_kN)
