# Grasshopper definition 20241113_Karamba 3D Geodesic Dome.gh (Grasshopper 1.0.8)
# plug-ins: Karamba3D, GhPolyhedra, Weaverbird, Kangaroo2 Components

panel = Panel("geodesic dome")
pt = Point(Point(-38, 9, 0))

number_slider = Slider(19703, range=0..20000)
# tethering the cutting surface to the point where dome is created
panel_2 = Panel("-0.5")
multiplication = Multiplication(A=number_slider, B=panel_2)
unit_x = UnitX(Factor=multiplication)
unit_y = UnitY(Factor=multiplication)
move = Move(Geometry=pt, Motion=unit_x)  # -> Geometry, Transform
move_2 = Move(Geometry=move.Geometry, Motion=unit_y)  # -> Geometry, Transform
plane_surface = PlaneSurface(Plane=move_2.Geometry, XSize=number_slider, YSize=number_slider)

radius = Slider(5000, range=0..5000)
xz = XZPlane(Origin=pt)
icosphere = IcoSphere(Plane=xz, Scale=radius, Density=Slider(2, range=0..5))
face_boundaries = FaceBoundaries(Mesh=icosphere)
boundary_surfaces = BoundarySurfaces(Edges=face_boundaries)
brep_join = BrepJoin(Breps=boundary_surfaces)  # -> Breps, Closed
brep = Brep(brep_join.Breps)
split_brep = SplitBrep(Brep=brep, Cutter=plane_surface)
dispatch = Dispatch(List=split_brep, DispatchPattern=[True, False])  # -> ListA, ListB
brep_2 = Brep(dispatch.ListA)

panel_3 = Panel("for karamba ")
addition = Addition(A=Slider(400, range=0..5000), B=radius)

icosphere_2 = IcoSphere(Plane=xz, Scale=addition, Density=Slider(3, range=0..5))
face_boundaries_2 = FaceBoundaries(Mesh=icosphere_2)
boundary_surfaces_2 = BoundarySurfaces(Edges=face_boundaries_2)
brep_join_2 = BrepJoin(Breps=boundary_surfaces_2)  # -> Breps, Closed
brep_3 = Brep(brep_join_2.Breps)
split_brep_2 = SplitBrep(Brep=brep_3, Cutter=plane_surface)
dispatch_2 = Dispatch(List=split_brep_2, DispatchPattern=[True, False])  # -> ListA, ListB
brep_4 = Brep(dispatch_2.ListA)

sphere = Sphere(Base=xz, Radius=addition)
split_brep_3 = SplitBrep(Brep=sphere, Cutter=plane_surface)
cross_section_karamba3d = CroSec(
    FamilyNameOfCrossSection="DefaultCroSec",
    Diameter_cm=Slider(100, range=0..100),
    WallThickness_cm=Slider(10, range=0..10),
    mode="Circular Hollow")
dispatch_3 = Dispatch(List=split_brep_3, DispatchPattern=[True, False])  # -> ListA, ListB
brep_5 = Brep(dispatch_3.ListA)
brep_edges = BrepEdges(Brep=brep_2)  # -> Naked, Interior, NonManifold
brep_edges_2 = BrepEdges(Brep=brep_4)  # -> Naked, Interior, NonManifold
area = Area(Geometry=brep_2)  # -> Area, Centroid
area_2 = Area(Geometry=brep_4)  # -> Area, Centroid
merge = Merge(Data1=brep_edges.Naked, Data2=brep_edges.Interior)
mesh_breps_karamba3d = MeshBreps(MeshResolution=1, EdgeRefinementFactor=0.67, PointReduction=False, SmoothingStepSize=0, SmoothingIterations=5)  # -> Mesh, Info
weaverbird_s_mesh_from_lines_weave_back = WeaverbirdsMeshFromLinesWeaveBack(MaximumValence=4)
end_points = EndPoints(Curve=merge)  # -> Start, End
weaverbird_s_picture_frame = WeaverbirdsPictureFrame(MeshPolylines=weaverbird_s_mesh_from_lines_weave_back, Distance=Slider(3, range=0..10), InsetType=0)
subtraction = Subtraction(A=Slider(0, range=0..100), B=Slider(20, range=0..50))
weaverbird_s_mesh_thicken = WeaverbirdsMeshThicken(MeshCurves=weaverbird_s_picture_frame, Distance=subtraction, OffsetType=0)
extend_curve = Slider(0, range=0..200)
negative = Negative(Value=extend_curve)
pipe_thickness = Slider(41, range=0..50)
pipe = Pipe(Radius=pipe_thickness, Caps=0)
pipe_2 = Pipe(Radius=Slider(36, range=0..100), Caps=0)
addition_2 = Addition(A=Slider(10, range=0..10), B=pipe_thickness)

Z = UnitZ(Factor=1)
crv = Curve([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])
pt_2 = Point([Point(-4291.254042, 2637.655561, 0), Point(-4847.691802, 1375.332598, 0), Point(-4847.691802, -1357.332598, 0), Point(-5038, 9, 0), Point(4215.254042, 2637.655561, 0), Point(4771.691802, 1375.332598, 0)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])
material_selection_karamba3d = MatSelect(NameOrListIndexOfMaterial="S235 # Steel", menu=[dropdown(0), dropdown(0)])
multiplication_2 = Multiplication(A=Z, B="-1")
line_to_beam_karamba3d = LineToBeam(
    Line=crv,
    New=True,
    Remove=True,
    LimitDistance_m=0.005,
    Bending=True,
    SetBucklingLength=True,
    ToPolylineMaxAngle=0.03,
    ToPolylineTolerance=0.01,
    ToPolylineMaxEdgeLength=0.25)  # -> Element, Points, Info
pt_3 = Point([Point(55.29420852, 33.23567213, 16.68860984), Point(61.34447674, 33.23567213, 16.68860984), Point(58.33708844, 33.23567213, 19.64615193), Point(63.98688612, 33.23567213, 19.64615193), Point(52.39664932, 33.23567213, 19.64615193), Point(-4291.254042, 2637.655561, 0)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])
loads_karamba3d = Loads(Vector=multiplication_2, LCase="0", mode="Gravity")
support_karamba3d = Supp(PosInd=pt_3, menu=[buttons(off, off, on, off, off, on)])
assemble_model_karamba3d = Assemble(
    Point=pt_2,
    Elem=line_to_beam_karamba3d.Element,
    Support=support_karamba3d,
    Load=loads_karamba3d,
    CrossSection=cross_section_karamba3d,
    Material=material_selection_karamba3d,
    LimitDistance_m=0.005)  # -> Model, Info, Mass_kg, CentreOfGravity, LoadCaseNames

eigen_modes_karamba3d = EModes(
    Model=assemble_model_karamba3d.Model,
    FromIndex=1,
    NumberOfModes=1,
    WithThIIEffects=True,
    MaximumNumberOfIterations=300,
    Epsilon=1e-07)  # -> ModelWithEigenModes, Eigenvalues
connected_parts_karamba3d = ConParts(Model=assemble_model_karamba3d.Model)  # -> ConnectedLines, ConnectedMeshes
param_viewer = ParamViewer(connected_parts_karamba3d.ConnectedLines)

analyze_karamba3d = Analyze(Model=eigen_modes_karamba3d.ModelWithEigenModes)  # -> CalculatedModel, MaximumDisplacement_cm, ResultingForceOfGravity_kN, ElasticEnergyChange_kNm
model_view_karamba3d = ModelView(Model=analyze_karamba3d.CalculatedModel, ResultFactors=1, ResultCase=-1)  # -> Model, DeformedMesh, DeformedAxes, DeformedModel
beam_view_karamba3d = BeamView(Model=model_view_karamba3d.Model)  # -> Model, MeshesOfRenderedBeams, DeformedBeamAxes, LegendColours, LegendTags

explode = Explode(Curve=[brep_edges_2.Naked, brep_edges_2.Interior], Recursive=True)  # -> flatten(Segments), Vertices
extend_curve_2 = ExtendCurve(Curve=merge, Type=0, Start=negative, End=negative)
end = EndPoints(Curve=extend_curve_2)  # -> Start, End

end_points_2 = EndPoints(Curve=extend_curve_2)  # -> Start, End
# EXTRUDE LINE VIA NORMAL TO ACT AS MEMBERS FOR THE EXTERNAL LAYER
line = Line(StartPoint=end_points.Start, EndPoint=end_points_2.Start)
line_2 = Line(StartPoint=end_points.End, EndPoint=end_points_2.End)
merge_2 = Merge(Data1=line, Data2=line_2)
mp = MultiPipe(Curves=merge_2, NodeSize=addition_2, EndOffset=1, StrutSize=1, Segment=0, KinkAngle=0.6, CubeFit=0)

deconstruct_brep = DeconstructBrep()  # -> Faces, Edges, Vertices
boundary_surfaces_3 = BoundarySurfaces(Edges=deconstruct_brep.Faces)

area_3 = Area(Geometry=boundary_surfaces_3)  # -> Area, Centroid

deconstruct_brep_2 = DeconstructBrep(Brep=brep_2)  # -> Faces, Edges, Vertices
fillet = Fillet(Curve=deconstruct_brep_2.Faces, Radius=Slider(0.713, range=0..1))
boundary_surfaces_4 = BoundarySurfaces(Edges=fillet)
# connect last - makes model slow
number_slider_2 = Slider(0.907, range=0..1)

point = Point(deconstruct_brep_2.Vertices)
pull_point = PullPoint(Point=point, Geometry=brep_5, ClosestOnly=True)  # -> ClosestPoint, Distance

line_3 = Line(StartPoint=point, EndPoint=pull_point.ClosestPoint)

area_4 = Area(Geometry=boundary_surfaces_4)  # -> Area, Centroid

line_4 = Line(StartPoint=area_2.Centroid, EndPoint=area_3.Centroid)
amplitude = Amplitude(Vector=line_4, Amplitude=Slider(0.823, range=0..10))
move_3 = Move(Geometry=boundary_surfaces_3, Motion=amplitude)  # -> Geometry, Transform

area_5 = Area(Geometry=move_3.Geometry)  # -> Area, Centroid

scale = Scale(Geometry=move_3.Geometry, Center=area_5.Centroid, Factor=Slider(0.9, range=0..1))  # -> Geometry, Transform
boundary_surfaces_5 = BoundarySurfaces(Edges=scale.Geometry)

line_5 = Line(StartPoint=area.Centroid, EndPoint=area_4.Centroid)
amplitude_2 = Amplitude(Vector=line_5, Amplitude=Slider(0.823, range=0..10))
move_4 = Move(Geometry=boundary_surfaces_4, Motion=amplitude_2)  # -> Geometry, Transform

area_6 = Area(Geometry=move_4.Geometry)  # -> Area, Centroid

scale_2 = Scale(Geometry=move_4.Geometry, Center=area_6.Centroid, Factor=number_slider_2)  # -> Geometry, Transform
boundary_surfaces_6 = BoundarySurfaces(Edges=scale_2.Geometry)
