# Grasshopper definition 20241113_Karamba 3D_Large geodesic node.gh (Grasshopper 1.0.8)
# plug-ins: Karamba3D

cross_section_karamba3d = CroSec(
    FamilyNameOfCrossSection="DefaultCroSec",
    Diameter_cm=Slider(100, range=0..100),
    WallThickness_cm=0.4,
    mode="Circular Hollow")

unit_z = UnitZ(Factor=1)
multiplication = Multiplication(A=unit_z, B="-1")
loads_karamba3d = Loads(Vector=multiplication, LCase="0", mode="Gravity")

curve = Curve([<curve referenced from the Rhino model> x264])
line_to_beam_karamba3d = LineToBeam(
    Line=curve,
    New=True,
    Remove=True,
    LimitDistance_m=0.005,
    Bending=True,
    SetBucklingLength=True,
    ToPolylineMaxAngle=0.03,
    ToPolylineTolerance=0.01,
    ToPolylineMaxEdgeLength=0.25)  # -> Element, Points, Info
element = ElementKaramba3D(line_to_beam_karamba3d.Element)

point = Point([<point referenced from the Rhino model> x94])
support_karamba3d = Supp(PosInd=point, menu=[buttons(on, on, on, off, off, off)])

material_selection_karamba3d = MatSelect(menu=[dropdown(0), dropdown(0)])
point_2 = Point(<point referenced from the Rhino model>)
assemble_model_karamba3d = Assemble(
    Point=point_2,
    Elem=element,
    Support=support_karamba3d,
    Load=loads_karamba3d,
    CrossSection=cross_section_karamba3d,
    Material=material_selection_karamba3d,
    LimitDistance_m=0.005)  # -> Model, Info, Mass_kg, CentreOfGravity, LoadCaseNames

connected_parts_karamba3d = ConParts(Model=assemble_model_karamba3d.Model)  # -> ConnectedLines, ConnectedMeshes
param_viewer = ParamViewer(connected_parts_karamba3d.ConnectedLines)

analyze_karamba3d = Analyze(Model=assemble_model_karamba3d.Model)  # -> CalculatedModel, MaximumDisplacement_cm, ResultingForceOfGravity_kN, ElasticEnergyChange_kNm
model_view_karamba3d = ModelView(Model=analyze_karamba3d.CalculatedModel, DeformationDirection=2)  # -> Model, DeformedMesh, DeformedAxes, DeformedModel, MaximumDeformation
utilization_of_elements_karamba3d = Utilization(
    AnalysedModel=model_view_karamba3d.Model,
    NumberOfSamplePoints=3,
    ElasticDesign=True,
    GammaM0=1,
    GammaM1=1.1,
    SwayFrame=True,
    WithDetails=False,
    mode="Beams")  # -> Model, Utilization, SigMax_kN_cm², SigMin_kN_cm², TauMax_kN_cm², UtilN, UtilVy, UtilVz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
beam_view_karamba3d = BeamView(Model=model_view_karamba3d.Model)  # -> Model, MeshesOfRenderedBeams, DeformedBeamAxes, LegendColours, LegendTags
panel = Panel(utilization_of_elements_karamba3d.UtilMt)
