# Grasshopper definition 20241113_domes_a new approach.gh (Grasshopper 1.0.8)
# plug-ins: Karamba3D

number_slider = Slider(5, range=0..10)
# Inverted Catenary - Shell
panel = Panel("0,1,0")
Z = UnitZ(Factor=1)
pt = Point(panel)
pt_2 = Point("10,1,0")
cat = Catenary(PointA=pt, PointB=pt_2, Length=Slider(10.8, range=10..20), Gravity=Z)
ln = Line(StartPoint=pt, EndPoint=pt_2)
Y = UnitY(Factor=number_slider)
panel_2 = Panel("""0
1""")
explode = Explode(Curve=cat, Recursive=True)  # -> Segments, Vertices
line = Line(explode.Segments)
intcrv = Interpolate(Vertices=explode.Vertices, Degree=3, Periodic=False, KnotStyle=1)  # -> Curve, Length, Domain
end = EndPoints(Curve=intcrv.Curve)  # -> Start, End
frame = CurveFrame(Curve=reparameterize(intcrv.Curve), Parameter=panel_2)
crv = Curve(cat)
merge = Merge(Data1=end.Start, Data2=end.End)
Y_2 = UnitY(Factor=1)
move = Move(Geometry=intcrv.Curve, Motion=Y)  # -> Geometry, Transform
line_2 = LineSDL(Start=merge, Direction=Y_2, Length=number_slider)  # -> graft(Line)
shatter = Shatter(Curve=reparameterize(intcrv.Curve), Parameters="0.5")
merge_2 = Merge(Data1=intcrv.Curve, Data2=move.Geometry)
item = ListItem(List=shatter, Index=0, Wrap=True)
pln = Plane(graft(frame))
loft = Loft(
    Curves=reparameterize(merge_2),
    Options={Adjust=False, Closed=False, LoftEnds=0, LoftSimp=0, LoftType=0, Rebuild=10, Refit=0.01})
end_2 = EndPoints(Curve=item)  # -> Start, End
support_karamba3d = Supp(PosInd=end_2.End, menu=[buttons(off, on, off, off, on, off)])
mesh_breps_karamba3d = MeshBreps(
    Brep=loft,
    InclusionPoints=end_2.End,
    MeshResolution=Slider(0.1, range=0.1..1),
    EdgeRefinementFactor=0.67,
    PointReduction=False,
    SmoothingStepSize=0,
    SmoothingIterations=5)  # -> flatten(Mesh), Info
loads_karamba3d = Loads(Vector=Vector(0, 0, -1), LCase="0", mode="Gravity")
cross_section_karamba3d = CroSec(FamilyNameOfCrossSection="DefaultCroSec", Height_cm="3", mode="Shell - Const")
mesh_to_shell_karamba3d = MToShell(Mesh=mesh_breps_karamba3d.Mesh, CrossSection=cross_section_karamba3d, LimitDistance_m=0.005)  # -> Element, Points, Info
points_close_to_curve = PointsCloseToCurve(point=mesh_to_shell_karamba3d.Points, curve=line_2, tolerance=0.001)
support_karamba3d_2 = Supp(PosInd=points_close_to_curve, PlaneOfReference=pln, menu=[buttons(on, off, off, off, off, off)])
support = SupportKaramba3D(flatten([support_karamba3d_2, support_karamba3d]))
load = LoadKaramba3D(loads_karamba3d)
assemble_model_karamba3d = Assemble(Elem=mesh_to_shell_karamba3d.Element, Support=support, Load=load, LimitDistance_m=0.005)  # -> Model, Info, Mass_kg, CentreOfGravity, LoadCaseNames
analyze_karamba3d = Analyze(Model=assemble_model_karamba3d.Model)  # -> CalculatedModel, MaximumDisplacement_cm, ResultingForceOfGravity_kN, ElasticEnergyChange_kNm
model_view_karamba3d = ModelView(Model=analyze_karamba3d.CalculatedModel, ResultFactors=1, ResultCase=-1)  # -> Model, DeformedMesh, DeformedAxes, DeformedModel
shell_view_karamba3d = ShellView(Model=model_view_karamba3d.Model, IndexOfLayer=0)  # -> Model, MeshesOfRenderedShells, LegendColours, LegendTags
legend = Legend(Colour=shell_view_karamba3d.LegendColours, Tags=shell_view_karamba3d.LegendTags, LegendType=1)
line_3 = Line(ln)
Y_3 = UnitY(Factor=Slider(3, range=0..10))
move_2 = Move(Geometry=line_3, Motion=Y_3)  # -> Geometry, Transform
Z_2 = UnitZ(Factor=1)
shell_section_karamba3d = SForces(
    Model=shell_view_karamba3d.Model,
    IntersectionGeometry=move_2.Geometry,
    ProjectionDirection=Z_2,
    mode="Forces",
    menu=[checkbox(on), checkbox(on), checkbox(off), slider(16), slider(0.96), slider(32.01), checkbox(off), checkbox(off), checkbox(off), checkbox(on), checkbox(off), checkbox(off), checkbox(off), checkbox(off), checkbox(off), slider(1)])  # -> Model, CuttingCurves, FaceIndices, MeshesOfRenderedResults, CurvesOfRenderedResults, Ntt_kN_m, Nnn_kN_m, Ntn_kN_m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
bnd = Bounds(Numbers=flatten(shell_section_karamba3d.Mtt_kNm_m))
panel_3 = Panel(bnd)

# ==== cluster PointsCloseToCurve
point = ClusterInput()
curve = ClusterInput()
tolerance = ClusterInput()
point_2 = Point(point)
curve_2 = Curve(reparameterize(curve))
tolerance_2 = Number(tolerance)
curve_closest_point = CurveClosestPoint(Point=point_2, Curve=curve_2)  # -> Point, Parameter, Distance
smaller_than = SmallerThan(FirstNumber=curve_closest_point.Distance, SecondNumber=tolerance_2)  # -> SmallerThan, OrEqualTo
cull_pattern = CullPattern(List=point_2, CullPattern=smaller_than.OrEqualTo)
point_3 = Point(cull_pattern)
point_4 = ClusterOutput(point_3)
