# Grasshopper definition 20241114_Karamba 3D Geodesic Dome.gh (Grasshopper 1.0.8)
# plug-ins: Karamba3D, GhPolyhedra, Weaverbird, Kangaroo2 Components

# ---- group: testing karamba - nts
Z = UnitZ(Factor=1)
crv = Curve([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])
pt = Point([Point(-4291.254042, 2637.655561, 0), Point(-4847.691802, 1375.332598, 0), Point(-4847.691802, -1357.332598, 0), Point(-5038, 9, 0), Point(4215.254042, 2637.655561, 0), Point(4771.691802, 1375.332598, 0)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])
material_selection_karamba3d = MatSelect(NameOrListIndexOfMaterial="S235 # Steel", menu=[dropdown(0), dropdown(0)])
multiplication = Multiplication(A=Z, B="-1")
line_to_beam_karamba3d = LineToBeam(
    Line=crv,
    New=True,
    Remove=True,
    LimitDistance_m=0.005,
    Bending=True,
    SetBucklingLength=True,
    ToPolylineMaxAngle=0.03,
    ToPolylineTolerance=0.01,
    ToPolylineMaxEdgeLength=0.25)  # -> Element, Points, Info
pt_2 = Point([Point(55.29420852, 33.23567213, 16.68860984), Point(61.34447674, 33.23567213, 16.68860984), Point(58.33708844, 33.23567213, 19.64615193), Point(63.98688612, 33.23567213, 19.64615193), Point(52.39664932, 33.23567213, 19.64615193), Point(-4291.254042, 2637.655561, 0)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])
loads_karamba3d = Loads(Vector=multiplication, LCase="0", mode="Gravity")
support_karamba3d = Supp(PosInd=pt_2, menu=[buttons(on, on, on, on, on, on)])
cross_section_karamba3d = CroSec(
    FamilyNameOfCrossSection="DefaultCroSec",
    Diameter_cm=Slider(100, range=0..100),
    WallThickness_cm=Slider(10, range=0..10),
    mode="Circular Hollow")
assemble_model_karamba3d = Assemble(
    Point=pt,
    Elem=line_to_beam_karamba3d.Element,
    Support=support_karamba3d,
    Load=loads_karamba3d,
    CrossSection=cross_section_karamba3d,
    Material=material_selection_karamba3d,
    LimitDistance_m=0.005)  # -> Model, Info, Mass_kg, CentreOfGravity, LoadCaseNames
eigen_modes_karamba3d = EModes(
    Model=assemble_model_karamba3d.Model,
    FromIndex=1,
    NumberOfModes=1,
    WithThIIEffects=True,
    MaximumNumberOfIterations=300,
    Epsilon=1e-07)  # -> ModelWithEigenModes, Eigenvalues
connected_parts_karamba3d = ConParts(Model=assemble_model_karamba3d.Model)  # -> ConnectedLines, ConnectedMeshes
param_viewer = ParamViewer(connected_parts_karamba3d.ConnectedLines)
analyze_karamba3d = Analyze(Model=eigen_modes_karamba3d.ModelWithEigenModes)  # -> CalculatedModel, MaximumDisplacement_cm, ResultingForceOfGravity_kN, ElasticEnergyChange_kNm
model_view_karamba3d = ModelView(Model=analyze_karamba3d.CalculatedModel, ResultFactors=1, ResultCase=-1)  # -> Model, DeformedMesh, DeformedAxes, DeformedModel
beam_view_karamba3d = BeamView(Model=model_view_karamba3d.Model)  # -> Model, MeshesOfRenderedBeams, DeformedBeamAxes, LegendColours, LegendTags

# ---- group: more karamba testing - nts - still not quite working / Primary
crv_2 = Curve([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])
cross_section_karamba3d_2 = CroSec(
    FamilyNameOfCrossSection="DefaultCroSec",
    Diameter_cm=Slider(300, range=0..1000),
    WallThickness_cm=Slider(96, range=0..100),
    mode="Circular Hollow")
line_to_beam_karamba3d_2 = LineToBeam(
    Line=crv_2,
    New=True,
    Remove=True,
    LimitDistance_m=0.005,
    Bending=True,
    SetBucklingLength=True,
    ToPolylineMaxAngle=0.03,
    ToPolylineTolerance=0.01,
    ToPolylineMaxEdgeLength=0.25)  # -> Element, Points, Info

# ---- group: more karamba testing - nts - still not quite working / Secondary
crv_3 = Curve([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])
cross_section_karamba3d_3 = CroSec(
    FamilyNameOfCrossSection="DefaultCroSec",
    Diameter_cm=Slider(2500, range=0..10000),
    WallThickness_cm=Slider(75, range=0..100),
    mode="Circular Hollow")
line_to_beam_karamba3d_3 = LineToBeam(
    Line=crv_3,
    New=True,
    Remove=True,
    LimitDistance_m=0.005,
    Bending=True,
    SetBucklingLength=True,
    ToPolylineMaxAngle=0.03,
    ToPolylineTolerance=0.01,
    ToPolylineMaxEdgeLength=0.25)  # -> Element, Points, Info

# ---- group: more karamba testing - nts - still not quite working / Shared parameters
material_selection_karamba3d_2 = MatSelect(NameOrListIndexOfMaterial="S235 # Steel", menu=[dropdown(0), dropdown(0)])

Z_2 = UnitZ(Factor=1)
multiplication_2 = Multiplication(A=Z_2, B="-1")
loads_karamba3d_2 = Loads(Vector=multiplication_2, LCase=reverse("0"), mode="Gravity")

pt_3 = Point([Point(1400.585424, -16128.61105, 0), Point(3802.921448, -17537.76398, 0), Point(1400.585424, -26538.31268, 0), Point(3802.921448, -25129.15975, 0), Point(-1476.585424, -16128.61105, 0), Point(-3878.921448, -17537.76398, 0)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])
support_karamba3d_2 = Supp(PosInd=pt_3, menu=[buttons(on, on, on, on, on, on)])

# ---- group: more karamba testing - nts - still not quite working
assemble_model_karamba3d_2 = Assemble(
    Elem=[line_to_beam_karamba3d_2.Element, line_to_beam_karamba3d_3.Element],
    Support=support_karamba3d_2,
    Load=loads_karamba3d_2,
    CrossSection=cross_section_karamba3d_3,
    Material=material_selection_karamba3d_2,
    LimitDistance_m=0.005)  # -> Model, Info, Mass_kg, CentreOfGravity, LoadCaseNames
analyze_karamba3d_2 = Analyze(Model=assemble_model_karamba3d_2.Model)  # -> CalculatedModel, MaximumDisplacement_cm, ResultingForceOfGravity_kN, ElasticEnergyChange_kNm
model_view_karamba3d_2 = ModelView(Model=analyze_karamba3d_2.CalculatedModel, ResultFactors=1, ResultCase=-1)  # -> Model, DeformedMesh, DeformedAxes, DeformedModel
optimize_cross_section_karamba3d = OptiCroSec(
    Model=model_view_karamba3d_2.Model,
    CrossSections=cross_section_karamba3d_3,
    MaximumUtilization=1,
    MaximumDisplacement_cm=-1,
    MaximumVirtualWork_kNcm=0.01,
    NumberOfUtilizationIterations=5,
    NumberOfDisplacementIterations=5,
    NumberOfDisplacementIncrementsPerIteration=2,
    DisplacementTolerance=0.01,
    NumberOfSamplePoints=3,
    ElasticDesign=True,
    GammaM0=1,
    GammaM1=1.1,
    SwayFrame=True)  # -> OptimizedModel, Info, Mass_kg, MaximumDisplacement_cm, ElasticEnergyChange_kNm, MaximumUtilizationViewInsufficientCrossSections, MaximumDisplacementViewLimitCrossSections
beam_view_karamba3d_2 = BeamView(Model=model_view_karamba3d_2.Model)  # -> Model, MeshesOfRenderedBeams, DeformedBeamAxes, LegendColours, LegendTags
result_selector_karamba3d = ResultSelect(
    Model=model_view_karamba3d_2.Model,
    menu=[buttons(on, on), dropdown(0), dropdown(0), buttons(off, off, off, off, off, off, off), buttons(off, off, off, off, off, off), buttons(off, off, off, off, off, off, off, off), buttons(off, off, off, off, off, off, off, off)])  # -> Model, LoadCaseSelection
utilization_of_elements_karamba3d = Utilization(
    AnalysedModel=result_selector_karamba3d.Model,
    NumberOfSamplePoints=3,
    ElasticDesign=True,
    GammaM0=1,
    GammaM1=1.1,
    SwayFrame=True,
    WithDetails=False,
    mode="Beams")  # -> Model, Utilization, SigMax_kN_cm², SigMin_kN_cm², TauMax_kN_cm², UtilN, UtilVy, UtilVz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
# unsure of where to list items/how to analyse the utilisation. I also can't seem to associate multiple primary member cross-sections and secondary cross-sections (only can have one cross-section value)
legend = Legend(Colour=beam_view_karamba3d_2.LegendColours, Tags=["One Fish", "Two Fish", "Red Fish", "Blue Fish"], LegendType=1)
panel = Panel(utilization_of_elements_karamba3d.UtilN)

# ----
# dimensions are way off. default units are meters in karamba, whereas rhino model is in mm.
panel_2 = Panel(assemble_model_karamba3d_2.Model)
connected_parts_karamba3d_2 = ConParts(Model=assemble_model_karamba3d.Model)  # -> ConnectedLines, ConnectedMeshes
# Error message that keeps coming up:
# "There are 942 rigid body modes in the system. This means some parts can move freely without causing deformation.
#  Try to use the 'Eigen Modes'-component and activate the display of local coordinate axes: The first eigen-mode will be the rigid body motion.
#  If this does not help, check whether you have a pinned support directly attached to a hinge. A hinge introduces an extra node which may cause the problem.
#  When analyzing a flat shell structure one has to lock the rotation perpendicular to the plate in at least one node.
# 
# "
# 
# Honestly, I don't know why the error appears and sometimes it disappears. I thought it was to do with the support conditions, but that wasn't a consistent reason. I tried plugging in Eigen Modes, didn't do anything. A few times, I opened and closed Grasshopper, reconnected the curves/points and then it worked.
param_viewer_2 = ParamViewer(connected_parts_karamba3d_2.ConnectedLines)

# ---- group: geodesic dome geometry
# EXTRUDE LINE VIA NORMAL TO ACT AS MEMBERS FOR THE EXTERNAL LAYER
# connect last - makes model slow
pt_4 = Point(Point(-38, 9, 0))
panel_3 = Panel("for karamba ")
weaverbird_s_mesh_from_lines_weave_back = WeaverbirdsMeshFromLinesWeaveBack(MaximumValence=4)
weaverbird_s_picture_frame = WeaverbirdsPictureFrame(MeshPolylines=weaverbird_s_mesh_from_lines_weave_back, Distance=Slider(3, range=0..10), InsetType=0)
subtraction = Subtraction(A=Slider(0, range=0..100), B=Slider(20, range=0..50))
weaverbird_s_mesh_thicken = WeaverbirdsMeshThicken(MeshCurves=weaverbird_s_picture_frame, Distance=subtraction, OffsetType=0)
extend_curve = Slider(0, range=0..200)
negative = Negative(Value=extend_curve)
pipe_thickness = Slider(41, range=0..50)
pipe = Pipe(Radius=pipe_thickness, Caps=0)
pipe_2 = Pipe(Radius=Slider(36, range=0..100), Caps=0)
addition = Addition(A=Slider(10, range=0..10), B=pipe_thickness)

number_slider = Slider(19703, range=0..20000)
# tethering the cutting surface to the point where dome is created
panel_4 = Panel("-0.5")
multiplication_3 = Multiplication(A=number_slider, B=panel_4)
unit_x = UnitX(Factor=multiplication_3)
unit_y = UnitY(Factor=multiplication_3)
move = Move(Geometry=pt_4, Motion=unit_x)  # -> Geometry, Transform
move_2 = Move(Geometry=move.Geometry, Motion=unit_y)  # -> Geometry, Transform
plane_surface = PlaneSurface(Plane=move_2.Geometry, XSize=number_slider, YSize=number_slider)

radius = Slider(5000, range=0..5000)
xz = XZPlane(Origin=pt_4)
icosphere = IcoSphere(Plane=xz, Scale=radius, Density=Slider(2, range=0..5))
face_boundaries = FaceBoundaries(Mesh=icosphere)
boundary_surfaces = BoundarySurfaces(Edges=face_boundaries)
brep_join = BrepJoin(Breps=boundary_surfaces)  # -> Breps, Closed
brep = Brep(brep_join.Breps)
split_brep = SplitBrep(Brep=brep, Cutter=plane_surface)
dispatch = Dispatch(List=split_brep, DispatchPattern=[True, False])  # -> ListA, ListB
brep_2 = Brep(dispatch.ListA)

addition_2 = Addition(A=Slider(400, range=0..5000), B=radius)
sphere = Sphere(Base=xz, Radius=addition_2)
split_brep_2 = SplitBrep(Brep=sphere, Cutter=plane_surface)
dispatch_2 = Dispatch(List=split_brep_2, DispatchPattern=[True, False])  # -> ListA, ListB
brep_3 = Brep(dispatch_2.ListA)
brep_edges = BrepEdges(Brep=brep_2)  # -> Naked, Interior, NonManifold
area = Area(Geometry=brep_2)  # -> Area, Centroid
merge = Merge(Data1=brep_edges.Naked, Data2=brep_edges.Interior)
end_points = EndPoints(Curve=merge)  # -> Start, End

icosphere_2 = IcoSphere(Plane=xz, Scale=addition_2, Density=Slider(3, range=0..5))
face_boundaries_2 = FaceBoundaries(Mesh=icosphere_2)
boundary_surfaces_2 = BoundarySurfaces(Edges=face_boundaries_2)
brep_join_2 = BrepJoin(Breps=boundary_surfaces_2)  # -> Breps, Closed
brep_4 = Brep(brep_join_2.Breps)
split_brep_3 = SplitBrep(Brep=brep_4, Cutter=plane_surface)
dispatch_3 = Dispatch(List=split_brep_3, DispatchPattern=[True, False])  # -> ListA, ListB
brep_5 = Brep(dispatch_3.ListA)

extend_curve_2 = ExtendCurve(Curve=merge, Type=0, Start=negative, End=negative)
end = EndPoints(Curve=extend_curve_2)  # -> Start, End

brep_edges_2 = BrepEdges(Brep=brep_5)  # -> Naked, Interior, NonManifold
area_2 = Area(Geometry=brep_5)  # -> Area, Centroid
end_points_2 = EndPoints(Curve=extend_curve_2)  # -> Start, End
line = Line(StartPoint=end_points.Start, EndPoint=end_points_2.Start)
line_2 = Line(StartPoint=end_points.End, EndPoint=end_points_2.End)
merge_2 = Merge(Data1=line, Data2=line_2)
mp = MultiPipe(Curves=merge_2, NodeSize=addition, EndOffset=1, StrutSize=1, Segment=0, KinkAngle=0.6, CubeFit=0)

explode = Explode(Curve=[brep_edges_2.Naked, brep_edges_2.Interior], Recursive=True)  # -> flatten(Segments), Vertices

deconstruct_brep = DeconstructBrep()  # -> Faces, Edges, Vertices
boundary_surfaces_3 = BoundarySurfaces(Edges=deconstruct_brep.Faces)

deconstruct_brep_2 = DeconstructBrep(Brep=brep_2)  # -> Faces, Edges, Vertices
fillet = Fillet(Curve=deconstruct_brep_2.Faces, Radius=Slider(0.713, range=0..1))
boundary_surfaces_4 = BoundarySurfaces(Edges=fillet)

point = Point(deconstruct_brep_2.Vertices)
pull_point = PullPoint(Point=point, Geometry=brep_3, ClosestOnly=True)  # -> ClosestPoint, Distance
area_3 = Area(Geometry=boundary_surfaces_3)  # -> Area, Centroid
area_4 = Area(Geometry=boundary_surfaces_4)  # -> Area, Centroid

line_3 = Line(StartPoint=point, EndPoint=pull_point.ClosestPoint)

line_4 = Line(StartPoint=area_2.Centroid, EndPoint=area_3.Centroid)
amplitude = Amplitude(Vector=line_4, Amplitude=Slider(0.823, range=0..10))
move_3 = Move(Geometry=boundary_surfaces_3, Motion=amplitude)  # -> Geometry, Transform

line_5 = Line(StartPoint=area.Centroid, EndPoint=area_4.Centroid)
amplitude_2 = Amplitude(Vector=line_5, Amplitude=Slider(0.823, range=0..10))
move_4 = Move(Geometry=boundary_surfaces_4, Motion=amplitude_2)  # -> Geometry, Transform

area_5 = Area(Geometry=move_3.Geometry)  # -> Area, Centroid
area_6 = Area(Geometry=move_4.Geometry)  # -> Area, Centroid

scale = Scale(Geometry=move_3.Geometry, Center=area_5.Centroid, Factor=Slider(0.9, range=0..1))  # -> Geometry, Transform
boundary_surfaces_5 = BoundarySurfaces(Edges=scale.Geometry)

scale_2 = Scale(Geometry=move_4.Geometry, Center=area_6.Centroid, Factor=Slider(0.907, range=0..1))  # -> Geometry, Transform
boundary_surfaces_6 = BoundarySurfaces(Edges=scale_2.Geometry)
