# Grasshopper definition Plan Trees.gh (Grasshopper 1.0.8)

point = Point(<point referenced from the Rhino model>)
construct_domain = ConstructDomain(DomainStart=Slider(0.134, range=0..0.5), DomainEnd=Slider(2, range=0..5))
random = Random(Range=construct_domain, Number=1, Seed=2)
curve = Curve([<curve referenced from the Rhino model> x5000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])
scale = Scale(Geometry=curve, Center=point, Factor=random)  # -> Geometry, Transform
random_2 = Random(Range=Domain(0, 1), Number=1, Seed=2)
rotate = Rotate(Geometry=scale.Geometry, Angle=random_2, Plane=point)  # -> Geometry, Transform

point_2 = Point(<point referenced from the Rhino model>)
construct_domain_2 = ConstructDomain(DomainStart=Slider(0.134, range=0..0.5), DomainEnd=Slider(2, range=0..5))
random_3 = Random(Range=construct_domain_2, Number=1, Seed=2)
curve_2 = Curve([<curve referenced from the Rhino model> x5000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])
scale_2 = Scale(Geometry=curve_2, Center=point_2, Factor=random_3)  # -> Geometry, Transform
random_4 = Random(Range=Domain(0, 1), Number=1, Seed=2)
rotate_2 = Rotate(Geometry=scale_2.Geometry, Angle=random_4, Plane=point_2)  # -> Geometry, Transform
